# Dynamo graph assembly_shipping_dimensions.dyn "Creación de vistas de montaje+colocación en plano" (Dynamo 3.6.0.9395)

select_model_elements_by = DSModelElementsByCategorySelection("OST_Assemblies")  # "Select Model Elements By Category"; 49 picked in the model
family_types = FamilyTypes("ROTULO A3:A3 ROTULO")
python_script = Python(IN[0]=select_model_elements_by, IN[1]=family_types)  # CPython3
# ---------- python_script.python (421 lines) ----------
import clr
import System
import math

# IMPORTS
try:
    clr.AddReference('RevitAPI')
    clr.AddReference('RevitServices')
    from Autodesk.Revit.DB import *
    from Autodesk.Revit.DB import BuiltInParameter  # Importar explícitamente
    from RevitServices.Persistence import DocumentManager
    from RevitServices.Transactions import TransactionManager
    doc = DocumentManager.Instance.CurrentDBDocument
except: pass

# ENTRADAS
try:
    assemblies = UnwrapElement(IN[0])      
    titleblock_type = UnwrapElement(IN[1])
except:
    assemblies = []
    titleblock_type = None

# CONFIGURACIÓN
t_name_3d = "10-Detalle 3D Montaje"
t_name_top = "2-PLANTA CUBIERTA" 
t_name_front = "3-Proyeccion MONTAJE" 
t_name_sched_col = "1-Planilla Pilares Montaje (no +House)"
t_name_sched_fram = "1-Planilla Vigas Montaje (no +House)"

# COORDENADAS A3
m_to_f = 3.28084 
layout = {
    "sched_fram": XYZ(0.320 * m_to_f, 0.285 * m_to_f, 0), 
    "sched_col":  XYZ(0.320 * m_to_f, 0.215 * m_to_f, 0), 
    "3d":         XYZ(0.335 * m_to_f, 0.135 * m_to_f, 0), 
    "front":      XYZ(0.140 * m_to_f, 0.230 * m_to_f, 0), 
    "top":        XYZ(0.140 * m_to_f, 0.035 * m_to_f, 0)  
}

# FUNCIONES AUXILIARES
def get_id_value(element_id):
    try:
        if hasattr(element_id, "Value"): return element_id.Value
        if hasattr(element_id, "IntegerValue"): return element_id.IntegerValue
    except: pass
    return -1

def get_orientation_by_members(assembly_instance, doc):
    try:
        member_ids = assembly_instance.GetMemberIds()
        max_span_x = 0.0
        max_span_y = 0.0
        members_found = 0
        
        for mid in member_ids:
            elem = doc.GetElement(mid)
            if not elem: continue
            
            cat_id = get_id_value(elem.Category.Id)
            if cat_id == -2001320 or cat_id == -2001330:
                bbox = elem.get_BoundingBox(None)
                if bbox:
                    len_x = abs(bbox.Max.X - bbox.Min.X)
                    len_y = abs(bbox.Max.Y - bbox.Min.Y)
                    if len_x > max_span_x: max_span_x = len_x
                    if len_y > max_span_y: max_span_y = len_y
                    members_found += 1
        
        debug = f"(X:{round(max_span_x,1)}, Y:{round(max_span_y,1)})"
        if members_found == 0: return AssemblyDetailViewOrientation.ElevationFront, "Front", debug

        if max_span_y > max_span_x:
            return AssemblyDetailViewOrientation.ElevationLeft, "Left", debug
        else:
            return AssemblyDetailViewOrientation.ElevationFront, "Front", debug
    except Exception as e:
        return AssemblyDetailViewOrientation.ElevationFront, "Front (Err)", str(e)

# ROTACIÓN INMEDIATA POST-CREACIÓN
def apply_rotation_immediately(doc, view, angle_degrees):
    """
    Intenta rotar la vista inmediatamente después de crearla,
    antes de regenerar o aplicar templates.
    Prueba múltiples métodos en secuencia.
    """
    try:
        angle_rad = math.radians(angle_degrees)
        
        # MÉTODO 1: Modificar Origin Rotation (para planos de trabajo)
        try:
            if hasattr(view, 'OriginRotation'):
                view.OriginRotation = angle_rad
                return "OriginRot"
        except: pass
        
        # MÉTODO 2: Rotar elementos dentro de la vista usando el centro del crop
        try:
            view.CropBoxActive = True
            bbox = view.CropBox
            center = (bbox.Min + bbox.Max) / 2.0
            axis = Line.CreateBound(center, center + XYZ(0, 0, 1))
            
            # Obtener todos los elementos visibles en la vista
            collector = FilteredElementCollector(doc, view.Id).WhereElementIsNotElementType()
            elem_ids = [e.Id for e in collector]
            
            if elem_ids:
                ElementTransformUtils.RotateElements(doc, System.Collections.Generic.List[ElementId](elem_ids), axis, angle_rad)
                return "ElemRot"
        except: pass
        
        # MÉTODO 3: Modificar el Sketch Plane si existe
        try:
            if hasattr(view, 'SketchPlane') and view.SketchPlane:
                sketch_plane = view.SketchPlane
                plane = sketch_plane.GetPlane()
                
                # Crear nuevo plano rotado
                new_normal = plane.Normal
                new_origin = plane.Origin
                
                # Rotar los vectores del plano
                cos_a = math.cos(angle_rad)
                sin_a = math.sin(angle_rad)
                
                x_axis = plane.XVec
                y_axis = plane.YVec
                
                new_x = XYZ(
                    x_axis.X * cos_a - y_axis.X * sin_a,
                    x_axis.Y * cos_a - y_axis.Y * sin_a,
                    x_axis.Z * cos_a - y_axis.Z * sin_a
                )
                
                new_plane = Plane.CreateByOriginAndBasis(new_origin, new_x, new_normal)
                new_sketch = SketchPlane.Create(doc, new_plane)
                view.SketchPlane = new_sketch
                return "SketchPlane"
        except: pass
        
        return None
        
    except Exception as e:
        return f"Error:{str(e)[:20]}"

def find_best_viewport_style(doc):
    """
    Busca el estilo de viewport sin título.
    Prioridad: 1) Por nombre, 2) Por parámetro Show Title, 3) Crear uno nuevo
    """
    try:
        collector = FilteredElementCollector(doc).OfClass(ElementType).OfCategory(BuiltInCategory.OST_Viewports)
        all_types = list(collector)
        if not all_types: return ElementId.InvalidElementId, "Ninguno"
        
        # PRIORIDAD 1: Buscar por nombre
        keywords = ["sin título", "sin titulo", "no title", "sin línea", "sin linea", "no line", "untitled", "without title"]
        
        for t in all_types:
            name_lower = t.Name.lower()
            if any(k in name_lower for k in keywords):
                return t.Id, t.Name
        
        # PRIORIDAD 2: Buscar por parámetro Show Title = False
        for t in all_types:
            try:
                show_title_param = t.get_Parameter(BuiltInParameter.VIEWPORT_ATTR_SHOW_TITLE_VIEWPORT)
                if show_title_param and show_title_param.AsInteger() == 0:
                    return t.Id, t.Name
            except: pass
        
        # PRIORIDAD 3: Tomar el primero y modificarlo
        return all_types[0].Id, all_types[0].Name
    except: 
        return ElementId.InvalidElementId, "Error"

def force_viewport_no_title(viewport, doc):
    """
    Fuerza que un viewport no muestre título.
    Usa el valor numérico directo del BuiltInParameter.
    """
    methods_tried = []
    
    try:
        # Método 1: Usar el valor numérico directo de VIEWPORT_ATTR_SHOW_TITLE_VIEWPORT
        # El valor es -1002053 para Show Title
        try:
            param = viewport.get_Parameter(ElementId(-1002053))
            if param and not param.IsReadOnly:
                param.Set(0)
                return "NumericBuiltIn"
        except Exception as e:
            methods_tried.append(f"Numeric_Fail:{str(e)[:15]}")
        
        # Método 2: Buscar en todos los parámetros del tipo de viewport
        try:
            vp_type = doc.GetElement(viewport.GetTypeId())
            if vp_type:
                param = vp_type.get_Parameter(ElementId(-1002053))
                if param and not param.IsReadOnly:
                    param.Set(0)
                    return "TypeNumeric"
        except Exception as e:
            methods_tried.append(f"TypeNumeric_Fail:{str(e)[:15]}")
        
        # Método 3: Parámetro por nombre en inglés
        try:
            param = viewport.LookupParameter("Show Title")
            if param and not param.IsReadOnly:
                param.Set(0)
                return "ShowTitle"
        except Exception as e:
            methods_tried.append(f"ShowTitle_Fail:{str(e)[:15]}")
        
        # Método 4: Parámetro en el tipo por nombre
        try:
            vp_type = doc.GetElement(viewport.GetTypeId())
            if vp_type:
                param = vp_type.LookupParameter("Show Title")
                if param and not param.IsReadOnly:
                    param.Set(0)
                    return "TypeShowTitle"
        except Exception as e:
            methods_tried.append(f"TypeShowTitle_Fail:{str(e)[:15]}")
        
        # Método 5: Buscar parámetro con "title" en cualquier parte
        try:
            vp_type = doc.GetElement(viewport.GetTypeId())
            if vp_type:
                for param in vp_type.Parameters:
                    param_name = param.Definition.Name.lower()
                    if "title" in param_name or "título" in param_name:
                        if not param.IsReadOnly and param.StorageType == StorageType.Integer:
                            param.Set(0)
                            return f"FoundInType:{param.Definition.Name}"
        except Exception as e:
            methods_tried.append(f"SearchType_Fail:{str(e)[:15]}")
        
        return f"FAILED:[{','.join(methods_tried)}]"
        
    except Exception as e:
        return f"ERROR:{str(e)[:30]}"

def get_template_id(doc, name):
    try:
        collector = FilteredElementCollector(doc).OfClass(View)
        for v in collector:
            if v.IsTemplate and v.Name == name: return v.Id
    except: pass
    return ElementId.InvalidElementId

# EJECUCIÓN
full_log = []
results = []

try:
    id_vp_style, style_name = find_best_viewport_style(doc)
    full_log.append(f"Estilo Título: {style_name}")

    id_3d = get_template_id(doc, t_name_3d)
    id_top = get_template_id(doc, t_name_top)
    id_front = get_template_id(doc, t_name_front)
    id_sch_col = get_template_id(doc, t_name_sched_col)
    id_sch_fram = get_template_id(doc, t_name_sched_fram)

    TransactionManager.Instance.EnsureInTransaction(doc)

    for asm in assemblies:
        log = [] 
        try:
            asm_id = asm.Id
            
            # 1. HOJA
            sheet = None
            try:
                sheet = AssemblyViewUtils.CreateSheet(doc, asm_id, titleblock_type.Id)
            except:
                sheet = ViewSheet.Create(doc, titleblock_type.Id)
                sheet.Name = asm.AssemblyTypeName

            # 2. ESCANEAR Y DECIDIR SI ROTAR
            view_orient, view_suffix, debug_vals = get_orientation_by_members(asm, doc)
            
            # NOTA: Para PCU no rotamos nada (ni planta ni alzado)
            # Para el resto, si es Left, la planta debería rotarse manualmente
            is_pcu = asm.AssemblyTypeName.startswith("PCU")
            
            if is_pcu:
                log_msg = f"{asm.AssemblyTypeName}: {view_suffix} {debug_vals} [PCU-SIN ROTAR]"
            else:
                log_msg = f"{asm.AssemblyTypeName}: {view_suffix} {debug_vals}"

            # 3. 3D
            view_3d = None
            try:
                view_3d = AssemblyViewUtils.Create3DOrthographic(doc, asm_id)
                if id_3d != ElementId.InvalidElementId: view_3d.ViewTemplateId = id_3d
                try: view_3d.Name = f"{asm.AssemblyTypeName} - 3D Final"
                except: pass
            except: pass

            # 4. 2D (CREAR VISTAS DE MONTAJE)
            # Para PCU: usar siempre orientación por defecto (no Left)
            # Para otros: usar la orientación detectada
            created_views_2d = []
            
            # PLANTA (Top) - siempre igual
            try:
                res = AssemblyViewUtils.CreateDetailSection(doc, asm_id, AssemblyDetailViewOrientation.ElevationTop)
                v_top = doc.GetElement(res) if isinstance(res, ElementId) else res
                
                if id_top != ElementId.InvalidElementId: 
                    v_top.ViewTemplateId = id_top
                try: 
                    v_top.Name = f"{asm.AssemblyTypeName} - Top"
                except: pass
                created_views_2d.append((v_top, {"pos": "top", "scale": 25}))
            except Exception as e:
                log_msg += f" [TopErr:{str(e)[:20]}]"
            
            # ALZADO (Front) - Para PCU usar siempre Front, no Left
            try:
                if is_pcu and view_suffix == "Left":
                    # Forzar orientación Front para PCU verticales
                    orientation = AssemblyDetailViewOrientation.ElevationFront
                    log_msg += " [Forzado:Front]"
                else:
                    # Usar orientación detectada
                    orientation = view_orient
                
                res = AssemblyViewUtils.CreateDetailSection(doc, asm_id, orientation)
                v_front = doc.GetElement(res) if isinstance(res, ElementId) else res
                if id_front != ElementId.InvalidElementId: 
                    v_front.ViewTemplateId = id_front
                try: 
                    v_front.Name = f"{asm.AssemblyTypeName} - View"
                except: pass
                created_views_2d.append((v_front, {"pos": "front", "scale": 25}))
            except Exception as e:
                log_msg += f" [FrontErr:{str(e)[:20]}]"

            # 5. REGENERAR
            doc.Regenerate()
            
            # 6. COLOCAR EN HOJA Y FORZAR SIN TÍTULO (CON DEBUG)
            title_debug = []
            if sheet:
                # 3D
                if view_3d:
                    try:
                        if Viewport.CanAddViewToSheet(doc, sheet.Id, view_3d.Id):
                            vp = Viewport.Create(doc, sheet.Id, view_3d.Id, layout["3d"])
                            # Cambiar tipo
                            if id_vp_style != ElementId.InvalidElementId: 
                                try: 
                                    vp.ChangeTypeId(id_vp_style)
                                    doc.Regenerate()
                                except: pass
                            # Forzar sin título
                            result = force_viewport_no_title(vp, doc)
                            title_debug.append(f"3D:{result}")
                            try: view_3d.Scale = 50 
                            except: pass
                    except: pass

                # 2D
                for v_obj, cfg in created_views_2d:
                    try:
                        if Viewport.CanAddViewToSheet(doc, sheet.Id, v_obj.Id):
                            vp = Viewport.Create(doc, sheet.Id, v_obj.Id, layout[cfg["pos"]])
                            # Cambiar tipo
                            if id_vp_style != ElementId.InvalidElementId: 
                                try: 
                                    vp.ChangeTypeId(id_vp_style)
                                    doc.Regenerate()
                                except: pass
                            # Forzar sin título
                            result = force_viewport_no_title(vp, doc)
                            title_debug.append(f"{cfg['pos']}:{result}")
                            try: v_obj.Scale = cfg["scale"]
                            except: pass
                    except: pass
            
            # Agregar info de título al log
            if title_debug:
                log_msg += f" [Títulos: {', '.join(title_debug)}]"

            # 7. TABLAS
            if id_sch_fram != ElementId.InvalidElementId:
                try:
                    fram_cat = ElementId(BuiltInCategory.OST_StructuralFraming)
                    res = AssemblyViewUtils.CreateSingleCategorySchedule(doc, asm_id, fram_cat, id_sch_fram, True)
                    sid = res.Id if isinstance(res, Element) else res
                    doc.Regenerate()
                    ScheduleSheetInstance.Create(doc, sheet.Id, sid, layout["sched_fram"])
                except: pass

            if id_sch_col != ElementId.InvalidElementId:
                try:
                    col_cat = ElementId(BuiltInCategory.OST_StructuralColumns)
                    res = AssemblyViewUtils.CreateSingleCategorySchedule(doc, asm_id, col_cat, id_sch_col, True)
                    sid = res.Id if isinstance(res, Element) else res
                    doc.Regenerate()
                    ScheduleSheetInstance.Create(doc, sheet.Id, sid, layout["sched_col"])
                except: pass
            
            log_msg += " -> OK"
            log.append(log_msg)

        except Exception as e:
            log.append(f"{asm.AssemblyTypeName}: ERROR {e}")

        results.append("\n".join(log))

    TransactionManager.Instance.TransactionTaskDone()

except Exception as e:
    full_log.append(f"ERROR CRÍTICO: {e}")

OUT = "\n".join(full_log) + "\n" + "\n".join(results)
# ----------------------------------------
watch = Watch(python_script)
